# Grasshopper definition p20_connect_control.ghx (Grasshopper 1.0.8)
# plug-ins: RhinoCodePluginGH

# ----
# P20 Connect Controller
reload = Button()
reload_2 = Python3Script(reload=reload)
# ---------- reload_2: Python ----------
if reload:
    from compas_rhino import unload_modules
    unload_modules("pump_control")
# ---------- end reload_2 ----------

# ----
# Pump Server
# Instructions:
# 
# 1. Start the Pump server
# 2. Ensure Pump is connected to R485 to USB converter and USB is connected to this PC
# 3. Connect the Pump Client (find correct COM port)
# 4. Control the pump using the Start/Stop and Speed settings (limited to -20 to 100)
button = Button()
pump_controller = Python3Script(start=button)  # -> out
# ---------- pump_controller: Python ----------
import os, pathlib
import subprocess
import pump_control.p20_connect.pump_server as ps

python = pathlib.Path(os.__file__).parents[1] /'python.exe'
pump_server = ps.__file__

assert pump_server
print(pump_server)

def start_script():
    args = [python, pump_server]
    result = subprocess.Popen(args,
        # stdout = subprocess.PIPE,
        # stderr = subprocess.PIPE
    )
    print("Server process started with PID:", result.pid)

if start:
    start_script()
# ---------- end pump_controller ----------

# ----
# Pump Client
speed = Slider(-20, range=-20..100)
button_2 = Button()
list = ValueList({"1", "2", "3", "4", "5", "6"}, selected="6")
pump_client = Python3Script(COM=list, connect=Button(), start=Button(), stop=Button(), set_spd=Toggle(True), speed=speed)  # -> out, a; inputs COM: Int32, speed: Int32
# ---------- pump_client: Python ----------
from scriptcontext import sticky as st
import imp
from compas_fab.ghpython.components import create_id
from pump_control import PumpClient
#pc = imp.load_source('module.name', path)

key = 'pumpclient'
if connect: 
    pumpclient = PumpClient()
    pumpclient.connect()
    pumpclient.connect_pump(COM)
    st[key] = pumpclient

pumpclient = st[key]
if start:
    pumpclient.start_pump()
if stop:
    pumpclient.stop_pump()
if set_spd:
    pumpclient.set_pump_speed(speed)
# ---------- end pump_client ----------
rec = DataRecorder(pump_client.out, DataLimit=-10, RecordData=True)
panel = Panel(rec)
